# Grasshopper definition daylight_guided_furniture_layout.gh (Grasshopper 1.0.7)

# ----
# Furniture
# Input
lounge_buffers = Curve([<curve referenced from the Rhino model> x2])
desk_buffer = Curve(<curve referenced from the Rhino model>)
bed_buffers = Curve([<curve referenced from the Rhino model> x2])
bed = Curve(<curve referenced from the Rhino model>)
desk = Curve(<curve referenced from the Rhino model>)
lounge = Curve(<curve referenced from the Rhino model>)

# ----
# Room
# Input
door_buffer = Curve(<curve referenced from the Rhino model>)
floor = Curve(<curve referenced from the Rhino model>)
win = Curve([<curve referenced from the Rhino model> x2])

rect2 = Curve(<curve referenced from the Rhino model>)
rect1 = Curve(<curve referenced from the Rhino model>)
# Custom Collision Detection
collision_detection = GhPythonScript(rect1=rect1, rect2=rect2)  # -> out, a, axes; inputs rect1: Curve, rect2: Curve
# ---------- collision_detection: Python ----------
import Rhino.Geometry as rh

class RectProps:
    def __init__(self, rect):
        self.geometry = rect
        self.center = rh.AreaMassProperties.Compute(rect).Centroid
        self.axis1 = rect.TangentAtStart
        self.axis2 = rect.TangentAtEnd
        self.vertices = self.getVertices()
    
    def getVertices(self):
        segments = self.geometry.DuplicateSegments()
        vertices = []
        for seg in segments:
            vertices.append(seg.PointAtStart)
        return vertices

# get corners projections
def project(rect1, rect2):
    dotvalue = 

rect1 = RectProps(rect1)
rect2 = RectProps(rect2)


a = rect2.center
axes = rect2.axis1
# ---------- end collision_detection ----------

# ----
# Floor plan subdivision
explode = Explode(Curve=floor, Recursive=True)  # -> Segments, Vertices
divlength = DivideLength(Curve=explode.Segments, Length="60")  # -> Points, Tangents, Parameters
hframe = HorizontalFrame(Curve=graft(explode.Segments), Parameter=divlength.Parameters)  # -> flatten(Frame)

# ----
# Sides that snap on walls
explode_2 = Explode(Curve=bed, Recursive=True)  # -> reparameterize(Segments), Vertices
explode_3 = Explode(Curve=lounge, Recursive=True)  # -> reparameterize(Segments), Vertices
explode_4 = Explode(Curve=desk, Recursive=True)  # -> reparameterize(Segments), Vertices
hframe_2 = HorizontalFrame(Curve=explode_2.Segments, Parameter="0.5")
hframe_3 = HorizontalFrame(Curve=explode_3.Segments, Parameter="0.5")
hframe_4 = HorizontalFrame(Curve=explode_4.Segments, Parameter="0.5")
panel = Panel("""1
0""")
item = ListItem(List=hframe_4, Index="2", Wrap=True)
item_2 = ListItem(List=hframe_3, Index="3", Wrap=True)
cull_i = CullIndex(List=hframe_2, Indices=panel, Wrap=True)  # -> graft(List)

panel_2 = Panel(collision_detection.axes)
vdis = VectorDisplay(Anchor=collision_detection.a, Vector=collision_detection.axes)

# ----
# Iterate arrangement combinations
# Bed
# Lounge
# Desk
orient = Orient(Geometry=desk, Source=item, Target=hframe)  # -> Geometry, Transform
orient_2 = Orient(Geometry=bed, Source=cull_i, Target=hframe)  # -> Geometry, Transform
orient_3 = Orient(Geometry=lounge, Source=item_2, Target=hframe)  # -> Geometry, Transform
bang = ExplodeTree(Data=orient_2.Geometry)  # -> _0000, _0001, Branch2
item_3 = ListItem(List=orient.Geometry, Index=Slider(1, range=0..26), Wrap=True)
item_4 = ListItem(List=bang._0001, Index=Slider(19, range=0..26), Wrap=True)
item_5 = ListItem(List=orient_3.Geometry, Index=Slider(3, range=0..26), Wrap=True)

# ----
# Iterate Furniture Combinations
beds = Curve(flatten(orient_2.Geometry))
lounges = Curve(orient_3.Geometry)
desks = Curve(orient.Geometry)
crossref = CrossReference(ListA=beds, ListB=lounges, ListC=desks, CrossMode=1)  # -> ListA, ListB, ListC
counts = Counts(L=beds, L_2=lounges, L_3=desks)
merge = Merge(Data1=simplify(graft(crossref.ListA)), Data2=simplify(graft(crossref.ListB)), Data3=simplify(graft(crossref.ListC)))
computing_space = Panel(counts)
collision_detection_2 = GhPythonScript(i_floor=floor, i_door=door_buffer, i_combinations=merge)  # -> out, o_combinations, o_count, a; inputs i_floor: Curve, i_door: Curve, i_win: Curve, i_combinations: tree of Curve
# ---------- collision_detection_2: Python ----------
import Rhino.RhinoDoc
import Rhino.Geometry as rh


# functions
def get_vertices(curves):
    vertices = []
    for curve in curves:
        segments = curve.DuplicateSegments()
        for seg in segments:
            vertices.append(seg.PointAtStart)
    return vertices
    
def get_vertices_middle(curves):
    vertices = []
    for curve in curves:
        segments = curve.DuplicateSegments()
        for seg in segments:
            len = seg.GetLength()
            mid = seg.PointAtLength(len / 2)
            vertices.append(seg.PointAtStart)
            vertices.append(mid)
    return vertices


# Collision Detection:
# pointContainment(unset = 0, inside = 1, outside = 2, coincident = 3)
tol = Rhino.RhinoDoc.ActiveDoc.ModelAbsoluteTolerance
combinations_filter = []
for i in range(i_combinations.BranchCount):
    rects = i_combinations.Branch(i)
    pts = get_vertices(rects)
    
    # Wall Collision: check if furniture vertices outside floor plan
    wall_collision = False
    for pt in pts:
        containment = int(i_floor.Contains(pt, rh.Plane.WorldXY, tol))
        if containment == 2: 
            wall_collision = True
            break
    if wall_collision:
        continue
    
    # Furniture Collision: check if furnitures collide each other
    furniture_collision = False
    obstacles = [] # add i_door to obstacles list
    for rect in rects:
        obstacles.append(rect)
    obstacles.append(i_door)
    pts_with_mid = get_vertices_middle(obstacles)
    for obstacle in obstacles:
        for pt in pts_with_mid:
            containment = int(obstacle.Contains(pt, rh.Plane.WorldXY, tol))
            if containment == 1:
                furniture_collision = True
                break
    if furniture_collision:
        continue

    # Need to implement buffer collisions
    # Furniture Combinations with no Collisions
    combinations_filter.append(rects)


# ouputs
o_combinations = combinations_filter
o_count = len(combinations_filter)
# ---------- end collision_detection_2 ----------
panel_3 = Panel(collision_detection_2.o_count)
visualize = GhPythonScript(i_combinations=collision_detection_2.o_combinations, index=Slider(300, range=0..300))  # -> out, o_combination; inputs i_combinations: list, index: Int32
# ---------- visualize: Python ----------
import Rhino.Geometry as rh

o_combination = i_combinations[index]
# ---------- end visualize ----------
# Define Evaluation logic
area = Area(Geometry=win)  # -> Area, Centroid
# Bed: Longer distance from window -> Higher score
# Lounge: Shorter distance from the window -> Higher score
# Desk: Shorter distance from the window -> Higher score
area_2 = Area()  # -> Area, Centroid
dist = Distance(PointA=area.Centroid, PointB=area_2.Centroid)
bang_2 = ExplodeTree(Data=dist)  # -> Branch0, Branch1, Branch2
num_bed = Number(bang_2.Branch0)
num_lounge = Number(bang_2.Branch1)
num_desk = Number(bang_2.Branch2)
panel_4 = Panel([num_bed, num_lounge, num_desk])
num_illuminance_proxy = Number(dist)

# ==== cluster Counts
L = ClusterInput()
L_2 = ClusterInput()
L_3 = ClusterInput()
lng = ListLength(List=L)
lng_2 = ListLength(List=L_2)
lng_3 = ListLength(List=L_3)
multiplication = Multiplication(A=lng, B=lng_2, C=lng_3)
R = ClusterOutput(multiplication)
